# Grasshopper definition 20210708_01_GlobeSrf.gh (Grasshopper 1.0.7)
# plug-ins: Bifocals

# ---- group: Globe Surface Creation
series = Series(Start=0, Step=Slider(7, range=0..10), Count=10)
bnd = Bounds(Numbers=series)
bnd_2 = Bounds(Numbers=series)
remap = RemapNumbers(Value=series, Source=bnd, Target=Domain(0, 1))  # -> Mapped, Clipped
remap_2 = RemapNumbers(Value=series, Source=bnd_2, Target=Domain(0, 1))  # -> Mapped, Clipped
graph = GraphMapper(
    remap.Mapped,
    x0=0,
    x1=1,
    y0=0,
    y1=1,
    container_name="Bezier",
    cpx=[0, 0.6224639416, 0.3637681901, 1],
    cpy=[0.3779163957, 0.004347622395, 0.7373188734, 0.3739128709])
graph_2 = GraphMapper(
    remap_2.Mapped,
    x0=0,
    x1=1,
    y0=0,
    y1=1,
    container_name="Bezier",
    cpx=[0, 0.3318839669, 0.6829710007, 1],
    cpy=[0.3779163957, 0.09057968855, 0.004347622395, 0.4283889532])
bricksize_mm = Panel("H25*W50*L100")
remap_3 = RemapNumbers(Value=graph, Source=Domain(0, 1), Target=bnd)  # -> Mapped, Clipped
remap_4 = RemapNumbers(Value=graph_2, Source=Domain(0, 1), Target=bnd_2)  # -> Mapped, Clipped
pt = ConstructPoint(XCoordinate=series, YCoordinate=remap_3.Mapped, ZCoordinate=0)
pt_2 = ConstructPoint(XCoordinate=series, YCoordinate=remap_4.Mapped, ZCoordinate=Slider(15, range=0..20))
intcrv = Interpolate(Vertices=pt, Degree=3, Periodic=False, KnotStyle=1)  # -> Curve, Length, Domain
intcrv_2 = Interpolate(Vertices=pt_2, Degree=3, Periodic=False, KnotStyle=1)  # -> Curve, Length, Domain
loft = Loft(
    Curves=[intcrv.Curve, intcrv_2.Curve],
    Options={Adjust=False, Closed=False, LoftEnds=0, LoftSimp=0, LoftType=0, Rebuild=10, Refit=0.01})

# ----
output = DataOutput(
    DataInput=loft,
    Destination="D:\Work\WS=2021_BrickRobotFab\globeSrf.ghdata",
    RelativePath="D:\Work\WS=2021_BrickRobotFab\globeSrf.ghdata|globeSrf.ghdata")
