# Grasshopper definition 20210708_02_LocalBrick.gh (Grasshopper 1.0.7)
# plug-ins: Bifocals

srf = Surface(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)

# ---- group: Brick Size
panel = Panel("25")
panel_2 = Panel("50.0")
panel_3 = Panel("12.5")
box = CenterBox(Base=PlaneXY(0, 0, 0), X=1, Y=1, Z=1)
edges = BrepEdges(Brep=box)  # -> Naked, Interior, NonManifold
linedim = LineDimension(Line=edges.Interior, Text="{0:0.00}", Size=Slider(3, range=0..10))

# ----
input = DataInput(
    Destination="D:\Work\WS=2021_BrickRobotFab\globeSrf.ghdata",
    RelativePath="D:\Work\WS=2021_BrickRobotFab\globeSrf.ghdata|globeSrf.ghdata",
    UpdateDelay=5)

# ---- group: ScaleToFit
bbox = BoundingBox(Content=srf, Plane=PlaneXY(0, 0, 0))  # -> Box, Box_2
boxprop = BoxProperties(Box=bbox.Box)  # -> Center, Diagonal, Area, Volume, Degeneracy
pdecon = Deconstruct(Point=boxprop.Diagonal)  # -> XComponent, YComponent, ZComponent
max = Maximum(A=pdecon.XComponent, B=pdecon.YComponent)
max_2 = Maximum(A=max, B=pdecon.ZComponent)
division = Division(A="1800", B=max_2)
scale = Scale(Geometry=srf, Center=Point(0, 0, 0), Factor=division)  # -> Geometry, Transform

# ----
brick_h_2 = Slider(12.5, range=0..30)
brick_w_2 = Slider(25, range=0..30)
brick_l_2 = Slider(50, range=0..60)
gap = Slider(8.6, range=0..10)
xy = XYPlane(Origin=Point(0, 0, 0))
Z = UnitZ(Factor=1)
addition = Addition(A=brick_l_2, B=gap)

# ---- group: Local Division
contour = Contour(Shape=scale.Geometry, Point=xy, Direction=Z, Distance=expr("x*2", brick_h_2))  # -> flatten(Contours)
panel_4 = Panel("""0
1""")
sift = SiftPattern(List=contour, SiftPattern=panel_4)  # -> Output0, graft(Output1)
merge = Merge(Data1="0", Data2=brick_l_2)
eval = EvaluateLength(Curve=sift.Output1, Length=merge, Normalized=Toggle(False))  # -> Point, Tangent, Parameter
shatter = Shatter(Curve=sift.Output1, Parameters=eval.Parameter)
item = ListItem(List=shatter, Index=0, Wrap=True)  # -> Item, Item1
combine = CombineData(Input0=sift.Output0, Input1=flatten(item.Item1))  # -> Result, Index
divlength = DivideLength(Curve=combine.Result, Length=expr("x*2", addition))  # -> Points, Tangents, Parameters

# ----
popgeo = PopulateGeometry(Geometry=scale.Geometry, Count=Slider(3, range=0..10), Seed=1)
crv = Curve(<curve referenced from the Rhino model>)

# ---- group: Brick Pattern
number_slider = Slider(-45, range=-45..45)
number_slider_2 = Slider(45, range=-45..45)
pl = ConstructPlane(Origin=divlength.Points, XAxis=divlength.Tangents, YAxis=Vector(0, 1, 0))
pull = PullPoint(Point=divlength.Points, Geometry=popgeo, ClosestOnly=True)  # -> ClosestPoint, Distance
bnd = Bounds(Numbers=flatten(pull.Distance))
dom = ConstructDomain(DomainStart=number_slider, DomainEnd=number_slider_2)
remap = RemapNumbers(Value=pull.Distance, Source=bnd, Target=dom)  # -> Mapped, Clipped
prot = RotatePlane(Plane=pl, Angle=degrees(remap.Mapped))

# ----
gradient = Gradient(
    LowerLimit=number_slider,
    UpperLimit=number_slider_2,
    Parameter=remap.Mapped,
    stops=[0.15: RGB(255, 130, 160), 0.85: RGB(0, 205, 219)])
box_2 = CenterBox(Base=prot, X=brick_l_2, Y=brick_w_2, Z=brick_h_2)
preview = CustomPreview(Geometry=box_2, Material=gradient)
