# Grasshopper definition 20210710_00_galapago.gh (Grasshopper 1.0.7)
# plug-ins: Bifocals

crv = Curve(<curve referenced from the Rhino model>)
crv_2 = Curve(<curve referenced from the Rhino model>)
number_slider = Slider(0.974, range=0..1)
number_slider_2 = Slider(1, range=0..1)
eval = EvaluateCurve(Curve=reparameterize(crv_2), Parameter=number_slider_2)  # -> Point, Tangent, Angle
eval_2 = EvaluateCurve(Curve=reparameterize(crv), Parameter=number_slider)  # -> Point, Tangent, Angle
ln = Line(StartPoint=eval_2.Point, EndPoint=eval.Point)
len = Length(Curve=ln)
panel = Panel(len)
num = Number(len)
galapagos = Galapagos(fitness=num, gene=[number_slider, number_slider_2])
