# Grasshopper definition v6_collisonTest.gh (Grasshopper 1.0.7)

geo = Geometry(Tree({0}: [{Plane=Plane(origin=(900, 336.5215838, 0), x=(-0.9096872141, 0.4152940795, 0), y=(-0.4152940795, -0.9096872141, 0)), X=Domain(-40, 40), Y=Domain(-20, 20), Z=Domain(-13, 13)}, {Plane=Plane(origin=(818.39693, 379.3295677, 0), x=(-0.9625320126, 0.2711680748, 0), y=(-0.2711680748, -0.9625320126, 0)), X=Domain(-40, 40), Y=Domain(-20, 20), Z=Domain(-13, 13)}, {Plane=Plane(origin=(732.6138854, 412.9605415, 0), x=(-0.9999655935, -0.008295283846, 0), y=(0.008295283846, -0.9999655935, 0)), X=Domain(-40, 40), Y=Domain(-20, 20), Z=Domain(-13, 13)}, {Plane=Plane(origin=(642.3233882, 430.3709639, 0), x=(-0.9544834656, -0.2982638325, 0), y=(0.2982638325, -0.9544834656, 0)), X=Domain(-40, 40), Y=Domain(-20, 20), Z=Domain(-13, 13)}, {Plane=Plane(origin=(552.298438, 414.5827818, 0), x=(-0.8781828852, -0.4783250151, 0), y=(0.4783250151, -0.8781828852, 0)), X=Domain(-40, 40), Y=Domain(-20, 20), Z=Domain(-13, 13)}, {Plane=Plane(origin=(475.679783, 364.1523591, 0), x=(-0.8396112151, -0.5431878197, 0), y=(0.5431878197, -0.8396112151, 0)), X=Domain(-40, 40), Y=Domain(-20, 20), Z=Domain(-13, 13)}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], {1}: [{Plane=Plane(origin=(862.7433029, 357.0149749, 26), x=(-0.9570714057, 0.2898522459, 0), y=(-0.2898522459, -0.9570714057, 0)), X=Domain(-40, 40), Y=Domain(-20, 20), Z=Domain(-13, 13)}, {Plane=Plane(origin=(774.5837493, 383.8907962, 26), x=(-0.9962400703, 0.08663557199, 0), y=(-0.08663557199, -0.9962400703, 0)), X=Domain(-40, 40), Y=Domain(-20, 20), Z=Domain(-13, 13)}, {Plane=Plane(origin=(683.8454014, 399.6368374, 26), x=(-0.9640931311, -0.2655643699, 0), y=(0.2655643699, -0.9640931311, 0)), X=Domain(-40, 40), Y=Domain(-20, 20), Z=Domain(-13, 13)}, {Plane=Plane(origin=(592.3034324, 393.2249891, 26), x=(-0.9171554716, -0.3985295987, 0), y=(0.3985295987, -0.9171554716, 0)), X=Domain(-40, 40), Y=Domain(-20, 20), Z=Domain(-13, 13)}, {Plane=Plane(origin=(508.4582309, 355.815146, 26), x=(-0.8877711114, -0.4602851874, 0), y=(0.4602851874, -0.8877711114, 0)), X=Domain(-40, 40), Y=Domain(-20, 20), Z=Domain(-13, 13)}, {Plane=Plane(origin=(435.6251867, 299.3722373, 26), x=(-0.9461033358, -0.3238649069, 0), y=(0.3238649069, -0.9461033358, 0)), X=Domain(-40, 40), Y=Domain(-20, 20), Z=Domain(-13, 13)}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], {2}: [{Plane=Plane(origin=(900, 348.4191602, 52), x=(-0.9658669265, 0.2590387621, 0), y=(-0.2590387621, -0.9658669265, 0)), X=Domain(-40, 40), Y=Domain(-20, 20), Z=Domain(-13, 13)}, {Plane=Plane(origin=(809.2458928, 364.5069159, 52), x=(-0.9971025992, 0.07606843381, 0), y=(-0.07606843381, -0.9971025992, 0)), X=Domain(-40, 40), Y=Domain(-20, 20), Z=Domain(-13, 13)}, {Plane=Plane(origin=(717.4585222, 372.7572014, 52), x=(-0.9625822335, -0.2709897486, 0), y=(0.2709897486, -0.9625822335, 0)), X=Domain(-40, 40), Y=Domain(-20, 20), Z=Domain(-13, 13)}, {Plane=Plane(origin=(625.6050232, 367.1499994, 52), x=(-0.8907991995, -0.4543971678, 0), y=(0.4543971678, -0.8907991995, 0)), X=Domain(-40, 40), Y=Domain(-20, 20), Z=Domain(-13, 13)}, {Plane=Plane(origin=(538.4951896, 337.8048381, 52), x=(-0.9203034809, -0.3912051931, 0), y=(0.3912051931, -0.9203034809, 0)), X=Domain(-40, 40), Y=Domain(-20, 20), Z=Domain(-13, 13)}, {Plane=Plane(origin=(459.6665048, 290.166272, 52), x=(-0.9697682109, -0.2440279023, 0), y=(0.2440279023, -0.9697682109, 0)), X=Domain(-40, 40), Y=Domain(-20, 20), Z=Domain(-13, 13)}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], {3}: [{Plane=Plane(origin=(860.0019632, 354.6207779, 78), x=(-0.9782268216, 0.2075386364, 0), y=(-0.2075386364, -0.9782268216, 0)), X=Domain(-40, 40), Y=Domain(-20, 20), Z=Domain(-13, 13)}, {Plane=Plane(origin=(767.8395399, 352.2062318, 78), x=(-0.997650935, -0.06850264216, 0), y=(0.06850264216, -0.997650935, 0)), X=Domain(-40, 40), Y=Domain(-20, 20), Z=Domain(-13, 13)}, {Plane=Plane(origin=(676.0348649, 344.024751, 78), x=(-0.8817988043, -0.471625772, 0), y=(0.471625772, -0.8817988043, 0)), X=Domain(-40, 40), Y=Domain(-20, 20), Z=Domain(-13, 13)}, {Plane=Plane(origin=(586.5398716, 322.524293, 78), x=(-0.9250707527, -0.3797948162, 0), y=(0.3797948162, -0.9250707527, 0)), X=Domain(-40, 40), Y=Domain(-20, 20), Z=Domain(-13, 13)}, {Plane=Plane(origin=(502.3449584, 285.1561461, 78), x=(-0.9766561151, -0.2148088284, 0), y=(0.2148088284, -0.9766561151, 0)), X=Domain(-40, 40), Y=Domain(-20, 20), Z=Domain(-13, 13)}, {Plane=Plane(origin=(420.8194284, 242.1279954, 78), x=(-0.9964066019, -0.08469878266, 0), y=(0.08469878266, -0.9964066019, 0)), X=Domain(-40, 40), Y=Domain(-20, 20), Z=Domain(-13, 13)}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], {4}: [{Plane=Plane(origin=(900, 360.3167366, 104), x=(-0.999880068, 0.01548708038, 0), y=(-0.01548708038, -0.999880068, 0)), X=Domain(-40, 40), Y=Domain(-20, 20), Z=Domain(-13, 13)}, {Plane=Plane(origin=(809.6233484, 342.0725362, 104), x=(-0.9888682708, -0.1487936259, 0), y=(0.1487936259, -0.9888682708, 0)), X=Domain(-40, 40), Y=Domain(-20, 20), Z=Domain(-13, 13)}, {Plane=Plane(origin=(719.219569, 323.9660287, 104), x=(-0.8886883131, -0.4585118125, 0), y=(0.4585118125, -0.8886883131, 0)), X=Domain(-40, 40), Y=Domain(-20, 20), Z=Domain(-13, 13)}, {Plane=Plane(origin=(629.6841109, 302.0791764, 104), x=(-0.8020944807, -0.5971971568, 0), y=(0.5971971568, -0.8020944807, 0)), X=Domain(-40, 40), Y=Domain(-20, 20), Z=Domain(-13, 13)}, {Plane=Plane(origin=(543.0725273, 270.5850154, 104), x=(-0.9010874992, -0.4336373125, 0), y=(0.4336373125, -0.9010874992, 0)), X=Domain(-40, 40), Y=Domain(-20, 20), Z=Domain(-13, 13)}, {Plane=Plane(origin=(458.5126916, 233.8430718, 104), x=(-0.9559648368, -0.2934812272, 0), y=(0.2934812272, -0.9559648368, 0)), X=Domain(-40, 40), Y=Domain(-20, 20), Z=Domain(-13, 13)}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], {5}: [{Plane=Plane(origin=(863.2657909, 350.4388386, 130), x=(-0.9756612736, -0.2192831027, 0), y=(0.2192831027, -0.9756612736, 0)), X=Domain(-40, 40), Y=Domain(-20, 20), Z=Domain(-13, 13)}, {Plane=Plane(origin=(777.1169829, 317.6180802, 130), x=(-0.9158989148, -0.4014089907, 0), y=(0.4014089907, -0.9158989148, 0)), X=Domain(-40, 40), Y=Domain(-20, 20), Z=Domain(-13, 13)}, {Plane=Plane(origin=(689.7248593, 288.2436885, 130), x=(-0.7880581495, -0.6156008065, 0), y=(0.6156008065, -0.7880581495, 0)), X=Domain(-40, 40), Y=Domain(-20, 20), Z=Domain(-13, 13)}, {Plane=Plane(origin=(602.4525161, 258.5237001, 130), x=(-0.8054654875, -0.592642682, 0), y=(0.592642682, -0.8054654875, 0)), X=Domain(-40, 40), Y=Domain(-20, 20), Z=Domain(-13, 13)}, {Plane=Plane(origin=(515.9997978, 226.4810538, 130), x=(-0.8927468797, -0.4505585519, 0), y=(0.4505585519, -0.8927468797, 0)), X=Domain(-40, 40), Y=Domain(-20, 20), Z=Domain(-13, 13)}, {Plane=Plane(origin=(428.130633, 198.7463461, 130), x=(-0.9526006866, -0.3042234901, 0), y=(0.3042234901, -0.9526006866, 0)), X=Domain(-40, 40), Y=Domain(-20, 20), Z=Domain(-13, 13)}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], {6}: [{Plane=Plane(origin=(900, 372.2143129, 156), x=(-0.9635736395, -0.2674431553, 0), y=(0.2674431553, -0.9635736395, 0)), X=Domain(-40, 40), Y=Domain(-20, 20), Z=Domain(-13, 13)}, {Plane=Plane(origin=(822.2482418, 322.7341517, 156), x=(-0.9313826487, -0.3640417032, 0), y=(0.3640417032, -0.9313826487, 0)), X=Domain(-40, 40), Y=Domain(-20, 20), Z=Domain(-13, 13)}, {Plane=Plane(origin=(740.4300784, 280.2798249, 156), x=(-0.8535504657, -0.5210101751, 0), y=(0.5210101751, -0.8535504657, 0)), X=Domain(-40, 40), Y=Domain(-20, 20), Z=Domain(-13, 13)}, {Plane=Plane(origin=(655.6656539, 244.0449008, 156), x=(-0.7479903802, -0.6637095684, 0), y=(0.6637095684, -0.7479903802, 0)), X=Domain(-40, 40), Y=Domain(-20, 20), Z=Domain(-13, 13)}, {Plane=Plane(origin=(569.3272694, 211.7149437, 156), x=(-0.8683741884, -0.4959095371, 0), y=(0.4959095371, -0.8683741884, 0)), X=Domain(-40, 40), Y=Domain(-20, 20), Z=Domain(-13, 13)}, {Plane=Plane(origin=(481.021629, 185.333389, 156), x=(-0.9466485035, -0.3222679177, 0), y=(0.3222679177, -0.9466485035, 0)), X=Domain(-40, 40), Y=Domain(-20, 20), Z=Domain(-13, 13)}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], {7}: [{Plane=Plane(origin=(870.9749782, 350.6467975, 182), x=(-0.9276696249, -0.3734020181, 0), y=(0.3734020181, -0.9276696249, 0)), X=Domain(-40, 40), Y=Domain(-20, 20), Z=Domain(-13, 13)}, {Plane=Plane(origin=(799.0446332, 293.0413447, 182), x=(-0.859948487, -0.5103808379, 0), y=(0.5103808379, -0.859948487, 0)), X=Domain(-40, 40), Y=Domain(-20, 20), Z=Domain(-13, 13)}, {Plane=Plane(origin=(721.4400682, 243.3454743, 182), x=(-0.7730235067, -0.6343773783, 0), y=(0.6343773783, -0.7730235067, 0)), X=Domain(-40, 40), Y=Domain(-20, 20), Z=Domain(-13, 13)}, {Plane=Plane(origin=(638.6316631, 202.9161655, 182), x=(-0.7329179605, -0.6803170314, 0), y=(0.6803170314, -0.7329179605, 0)), X=Domain(-40, 40), Y=Domain(-20, 20), Z=Domain(-13, 13)}, {Plane=Plane(origin=(551.7385054, 172.2730007, 182), x=(-0.8800053296, -0.4749638091, 0), y=(0.4749638091, -0.8800053296, 0)), X=Domain(-40, 40), Y=Domain(-20, 20), Z=Domain(-13, 13)}, {Plane=Plane(origin=(461.337332, 154.7483038, 182), x=(-0.9668036255, -0.2555205466, 0), y=(0.2555205466, -0.9668036255, 0)), X=Domain(-40, 40), Y=Domain(-20, 20), Z=Domain(-13, 13)}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], {8}: [{Plane=Plane(origin=(900, 384.1118893, 208), x=(-0.840379651, -0.5419981938, 0), y=(0.5419981938, -0.840379651, 0)), X=Domain(-40, 40), Y=Domain(-20, 20), Z=Domain(-13, 13)}, {Plane=Plane(origin=(839.8946092, 314.2706044, 208), x=(-0.8252509873, -0.5647661533, 0), y=(0.5647661533, -0.8252509873, 0)), X=Domain(-40, 40), Y=Domain(-20, 20), Z=Domain(-13, 13)}, {Plane=Plane(origin=(772.1537167, 251.7945673, 208), x=(-0.7495616137, -0.6619345793, 0), y=(0.6619345793, -0.7495616137, 0)), X=Domain(-40, 40), Y=Domain(-20, 20), Z=Domain(-13, 13)}, {Plane=Plane(origin=(697.0634587, 198.4389157, 208), x=(-0.6856069106, -0.7279719528, 0), y=(0.7279719528, -0.6856069106, 0)), X=Domain(-40, 40), Y=Domain(-20, 20), Z=Domain(-13, 13)}, {Plane=Plane(origin=(614.295508, 158.0903452, 208), x=(-0.7573494029, -0.6530098636, 0), y=(0.6530098636, -0.7573494029, 0)), X=Domain(-40, 40), Y=Domain(-20, 20), Z=Domain(-13, 13)}, {Plane=Plane(origin=(525.398074, 134.2393487, 208), x=(-0.9128955133, -0.4081933142, 0), y=(0.4081933142, -0.9128955133, 0)), X=Domain(-40, 40), Y=Domain(-20, 20), Z=Domain(-13, 13)}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]))

# ----
# CollisionTest
brick = Brep(geo)
mesh = MeshBrep(
    Brep=brick,
    Settings={GridMaxCount=0, GridMinCount=16, JaggedSeams=False, MaxEdgeLength=0, MinEdgeLength=0.0001, MinTolerance=0, Refine=True, RefineAngle=0, RelativeTolerance=0.65, SimplePlanes=True, Tolerance=0})
shift = ShiftList(List=mesh, Shift=1, Wrap=True)  # -> simplify(List)
graft = GraftTree(Tree=mesh, IncludeEmptyLists=True, IncludeNullItems=True)
graft_2 = GraftTree(Tree=shift, IncludeEmptyLists=True, IncludeNullItems=True)
colom = CollisionOneMany(Collider=graft, Obstacles=graft_2)  # -> Collision, Index
equals = Equality(FirstNumber=colom.Collision, SecondNumber=1)  # -> flatten(Equality), Inequality
cset = CreateSet(List=flatten(colom.Collision))  # -> Set, Map
tstat = TreeStatistics(Tree=colom.Collision)  # -> Paths, Length, Count
cull = CullPattern(List=tstat.Paths, CullPattern=equals.Equality)
panel = Panel(cset.Set)
branch = TreeBranch(Tree=[graft_2, graft], Path=cull, MaintainPaths=True)
